# Grasshopper definition GMK_SubD.gh (Grasshopper 1.0.7)

panel = Panel("""1
1.25
1.5
1.75
2.25
2.75""")
panel_2 = Panel("""R4
R3
R2
R1""")
panel_3 = Panel("""R1,9.8,9.8
R2,7.8,7.3
R3,7.2,6.2
R4,8.6,6.2""")
data = Data(panel)
split = TextSplit(Text=panel_3, Separators=",")
multiplication = Multiplication(A=data, B=19.05)
item = ListItem(List=split, Index=1, Wrap=True)  # -> flatten(Item)
item_2 = ListItem(List=split, Index=2, Wrap=True)  # -> flatten(Item)
item_3 = ListItem(List=split, Index=0, Wrap=True)  # -> flatten(Item)
ins = InsertItems(List=multiplication, Item=0, Indices=0, Wrap=True)
data_2 = Data(panel_2)
data_3 = Data(item)
data_4 = Data(item_2)
data_5 = Data(item_3)
ma = MassAddition(Input=ins)  # -> Result, PartialResults
cull_i = CullIndex(List=ma.PartialResults, Indices=-1, Wrap=True)
keysearch = KeyValueSearch(Keys=data_5, Values=data_3, Search=data_2)
keysearch_2 = KeyValueSearch(Keys=data_5, Values=data_4, Search=data_2)
lng = ListLength(List=data_2)
pt = ConstructPoint(XCoordinate=cull_i, YCoordinate=0, ZCoordinate=0)
series = Series(Start=0, Step=19.05, Count=lng)
xy = XYPlane(Origin=pt)
Y = UnitY(Factor=series)
move = Move(Geometry=xy, Motion=graft(Y))  # -> Geometry, Transform
rectangle = Rectangle(Plane=move.Geometry, XSize=multiplication, YSize=Domain(0, 19.05), Radius=0)  # -> Rectangle, Length
crv = Curve(rectangle.Rectangle)
bbox = BoundingBox(Content=crv, Plane=PlaneXY(0, 0, 0))  # -> Box, Box_2
debox = DeconstructBox(Box=bbox.Box)  # -> Plane, X, Y, Z
dedomain = DeconstructDomain(Domain=debox.X)  # -> Start, End
dedomain_2 = DeconstructDomain(Domain=debox.Y)  # -> Start, End
dedomain_3 = DeconstructDomain(Domain=debox.Z)  # -> Start, End
pt_2 = ConstructPoint(XCoordinate=dedomain.Start, YCoordinate=dedomain_2.Start, ZCoordinate=dedomain_3.Start)
subtraction = Subtraction(A=dedomain.End, B=dedomain.Start)
subtraction_2 = Subtraction(A=dedomain_2.End, B=dedomain_2.Start)
xy_2 = XYPlane(Origin=pt_2)
key_base_plane = Plane(xy_2)
x_size_mm = Data(subtraction)
y_size_mm = Data(subtraction_2)
data_6 = Data(graft(keysearch_2))
data_7 = Data(graft(keysearch))

# ----
# Size Label
key_base_plane_2 = Plane(key_base_plane)
x_size_mm_2 = Data(x_size_mm)
number_slider = Slider(2, range=0..10)
division = Division(A=x_size_mm_2, B=19.05)
format = Format(Format="{0:#.00}", Culture=127, Data0=division)
larger = LargerThan(FirstNumber=division, SecondNumber=1.01)  # -> LargerThan, OrEqualTo
vec = VectorXYZ(XComponent=number_slider, YComponent=number_slider, ZComponent=0)  # -> Vector, Length
long = LongestList(ListA=format, PaddingMode=2)  # -> ListA, ListB
int = Integer(larger.LargerThan)
move_2 = Move(Geometry=key_base_plane_2, Motion=vec.Vector)  # -> Geometry, Transform
p_n_c = PickNChoose(Pattern=int, Stream0=long.ListB, Stream1=long.ListA)
tag = TextTag3D(Location=move_2.Geometry, Text=p_n_c, Size=Slider(4, range=0..10), Justification=7)

# ----
# Top Rect
base_offset_mm = Data(Slider(0.5, range=0..1))
y_size_mm_2 = Data(y_size_mm)
x_offset_mm = Data(Slider(3, range=0..10))
y_upper_offset_mm = Data(Slider(0.5, range=0..1))
y_lower_offset_mm = Data(Slider(4, range=0..10))
z_upper = Data(data_7)
z_lower = Data(data_6)
x_size_mm_3 = Data(x_size_mm)
addition = Addition(A=base_offset_mm, B=x_offset_mm)
addition_2 = Addition(A=base_offset_mm, B=y_upper_offset_mm)
addition_3 = Addition(A=base_offset_mm, B=y_lower_offset_mm)
subtraction_3 = Subtraction(A=y_size_mm_2, B=addition_2)
subtraction_4 = Subtraction(A=x_size_mm_3, B=addition)
c_script = CSharpScript(x0=addition, x1=subtraction_4, y0=addition_3, y1=subtraction_3, z0=z_upper, z1=z_lower)  # -> out, A; inputs x0: Double, x1: Double, y0: Double, y1: Double, z0: Double, z1: Double
# ---------- c_script: C# ----------
var pline = new Polyline();

pline.Add(x0, y0, z0);
pline.Add(x1, y0, z0);
pline.Add(x1, y1, z1);
pline.Add(x0, y1, z1);
pline.Add(x0, y0, z0);

A = pline;
# ---------- end c_script ----------

crv_2 = Curve(c_script.A)
fillet = Fillet(Curve=crv_2, Radius=Slider(1.5, range=0..10))
explode = Explode(Curve=crv_2, Recursive=True)  # -> Segments, Vertices
item_4 = ListItem(List=explode.Segments, Index=1, Wrap=True)
item_5 = ListItem(List=explode.Segments, Index=0, Wrap=True)
explode_2 = Explode(Curve=fillet, Recursive=True)  # -> Segments, Vertices
panel_4 = Panel("""False
True""")
panel_5 = Panel("""False
True""")
end = EndPoints(Curve=item_5)  # -> Start, End
end_2 = EndPoints(Curve=item_4)  # -> Start, End
data_8 = Data(explode_2.Segments)
number_slider_2 = Slider(4, range=0..10)
number_slider_3 = Slider(3, range=0..10)
subtraction_5 = Subtraction(A=end.End, B=end.Start)
subtraction_6 = Subtraction(A=end_2.End, B=end_2.Start)
neg = Negative(Value=Slider(0.5, range=0..1))
cull = CullPattern(List=data_8, CullPattern=invert(panel_5))
cull_2 = CullPattern(List=data_8, CullPattern=panel_5)
multiplication_2 = Multiplication(A=subtraction_5, B=0.5)
Z = UnitZ(Factor=neg)
pl = ConstructPlane(Origin=end.Start, XAxis=subtraction_5, YAxis=subtraction_6)
Y_2 = Data(subtraction_6)
addition_4 = Addition(A=Z, B=multiplication_2)
fillet_2 = Curve(cull)
straight = Curve(cull_2)
arc = Arc3Pt(PointA=Point(0, 0, 0), PointB=addition_4, PointC=subtraction_5)  # -> Arc, Plane, Radius
darc = DeconstructArc(Arc=fillet_2)  # -> BasePlane, Radius, Angle
deplane = DeconstructPlane(Plane=darc.BasePlane)  # -> Origin, XAxis, YAxis, ZAxis
shift = ShiftList(List=fillet_2, Shift=1, Wrap=True)
item_6 = ListItem(List=deplane.Origin, Index=0, Wrap=True)
merge = Merge(Data1=deplane.Origin, Data2=item_6)
pline = PolyLine(Vertices=merge, Closed=False)
data_9 = Data(number_slider_2)
data_10 = Data(number_slider_2)
orient = Orient(Geometry=arc.Arc, Source=PlaneXY(0, 0, 0), Target=pl)  # -> Geometry, Transform
explode_3 = Explode(Curve=pline, Recursive=True)  # -> Segments, Vertices
pshift = ShiftPaths(Data=shift, Offset=-1)
pshift_2 = ShiftPaths(Data=explode_3.Segments, Offset=-1)
move_3 = Move(Geometry=orient.Geometry, Motion=expr("-0.5*x", Y_2))  # -> Geometry, Transform
divide = DivideCurve(Curve=straight, Count=number_slider_2, Kinks=False)  # -> Points, Tangents, Parameters
divide_2 = DivideCurve(Curve=pshift, Count=number_slider_3, Kinks=False)  # -> Points, Tangents, Parameters
divide_3 = DivideCurve(Curve=pshift_2, Count=data_10, Kinks=False)  # -> Points, Tangents, Parameters
extr = Extrude(Base=move_3.Geometry, Direction=expr("x*2", Y_2))
cull_i_2 = CullIndex(List=divide.Points, Indices="0", Wrap=True)
cull_i_3 = CullIndex(List=divide_2.Points, Indices="0", Wrap=True)
cull_i_4 = CullIndex(List=divide_3.Points, Indices="0", Wrap=True)
merge_2 = Merge(Data1=cull_i_2, Data2=cull_i_3)
pshift_3 = ShiftPaths(Data=merge_2, Offset="-2")
pshift_4 = ShiftPaths(Data=cull_i_4, Offset="-2")
c_script_2 = CSharpScript(
    outer=pshift_3,
    inner=pshift_4,
    nDivStraight=number_slider_2,
    nDivCorner=number_slider_3,
    filletRadius=Slider(0.5, range=0..1))  # -> out, A; inputs outer: list of Point3d, inner: list of Point3d, nDivStraight: Int32, nDivCorner: Int32, filletRadius: Double
# ---------- c_script_2: C# ----------
Mesh mesh = new Mesh();

//Generate vertices for fillet
var outerFilletVertices = new List<Point3d>();
for(int side=0; side<4; side++) {

    // outer/inner vertice count offset
    int ovOffset = side * (nDivStraight + nDivCorner);
    int ivOffset = side * (nDivStraight);

    for (int ov=0; ov<(nDivStraight + nDivCorner); ov++) {

        int iv = Math.Min(ov, nDivStraight-1);
        Vector3d v = inner[ivOffset + iv] - outer[ovOffset + ov];
        v.Unitize();
        outerFilletVertices.Add(outer[ovOffset + ov] + v * filletRadius);

    }
}

mesh.Vertices.AddVertices(outer);
mesh.Vertices.AddVertices(outerFilletVertices);
mesh.Vertices.AddVertices(inner);

// Generate outer faces
for (int side=0; side<4; side++) {

    int ovOffset = side * (nDivStraight + nDivCorner);
    int ivOffset = side * (nDivStraight);

    for (int ov=0; ov<(nDivStraight + nDivCorner); ov++) {
        int iv0 = Math.Min(ov, nDivStraight-1) + ivOffset;
        int iv1 = Math.Min(ov+1, nDivStraight-1) + ivOffset;
        if (ov == nDivStraight + nDivCorner - 1) {
            iv1++;
        }
        iv1 %= inner.Count;
        int ov0 = ov + ovOffset;
        int ov1 = (ov0 + 1) % outer.Count;
        mesh.Faces.AddFace(
            ov0,
            ov1,
            ov1+outer.Count,
            ov0+outer.Count
        );
        mesh.Faces.AddFace(
            ov0+outer.Count,
            ov1+outer.Count,
            iv1+2*outer.Count,
            iv0+2*outer.Count
        );
    }
}

// Generate Inner Vertices
Point3d origin = inner[inner.Count-1];
var innerxx = new List<Vector3d>();
var inneryy = new List<Vector3d>();
for (int i=0; i<nDivStraight-1; i++) {
    innerxx.Add(inner[i]-origin);
    inneryy.Add(inner[i+nDivStraight] - inner[nDivStraight-1]);
}
for (int y=0; y<inneryy.Count; y++) {
    for (int x=0; x<innerxx.Count; x++) {
        mesh.Vertices.Add(origin + innerxx[x] + inneryy[y]);
    }
}

// Generate hole ID array
int innerOffset = outer.Count * 2;
var innerVertexIds = new int[nDivStraight+1, nDivStraight+1];
for (int i=0; i<nDivStraight; i++) {
    innerVertexIds[i+1,0] = innerOffset + i;
    innerVertexIds[nDivStraight, i+1] = innerOffset + i + nDivStraight;
    innerVertexIds[nDivStraight-i-1, nDivStraight] = innerOffset + i + nDivStraight*2;
    innerVertexIds[0, nDivStraight-i-1] = innerOffset + i + nDivStraight*3;
}
int innerGridOffset = innerOffset + inner.Count;
for (int y=0; y<nDivStraight-1; y++) {
    for (int x=0; x<nDivStraight-1; x++) {
        innerVertexIds[x+1, y+1] = innerGridOffset + x + y*(nDivStraight-1);
    }
}

for (int x=0; x<nDivStraight; x++) {
    for (int y=0; y<nDivStraight; y++) {
        mesh.Faces.AddFace(
            innerVertexIds[x,y],
            innerVertexIds[x+1,y],
            innerVertexIds[x+1, y+1],
            innerVertexIds[x, y+1]
        );
    }
}



A = mesh;
# ---------- end c_script_2 ----------
demesh = DeconstructMesh(Mesh=c_script_2.A)  # -> Vertices, Faces, Colours, Normals

# ----
# Bottom Rect
y_size_mm_3 = Data(y_size_mm)
base_offset_mm_2 = Data(Slider(0.5, range=0..1))
x_size_mm_4 = Data(x_size_mm)

subtraction_7 = Subtraction(A=x_size_mm_4, B=base_offset_mm_2)
subtraction_8 = Subtraction(A=y_size_mm_3, B=base_offset_mm_2)

c_script_3 = CSharpScript(x0=base_offset_mm_2, x1=subtraction_7, y0=base_offset_mm_2, y1=subtraction_8, z0=0, z1=0)  # -> out, A; inputs x0: Double, x1: Double, y0: Double, y1: Double, z0: Double, z1: Double; same code as c_script

crv_3 = Curve(c_script_3.A)
fillet_3 = Fillet(Curve=crv_3, Radius=Slider(0.5, range=0..10))
explode_4 = Explode(Curve=fillet_3, Recursive=True)  # -> Segments, Vertices
data_11 = Data(explode_4.Segments)
cull_3 = CullPattern(List=data_11, CullPattern=invert(panel_4))
cull_4 = CullPattern(List=data_11, CullPattern=panel_4)
straight_2 = Curve(cull_4)
fillet_4 = Curve(cull_3)
darc_2 = DeconstructArc(Arc=fillet_4)  # -> BasePlane, Radius, Angle
deplane_2 = DeconstructPlane(Plane=darc_2.BasePlane)  # -> Origin, XAxis, YAxis, ZAxis
shift_2 = ShiftList(List=fillet_4, Shift=1, Wrap=True)
item_7 = ListItem(List=deplane_2.Origin, Index=0, Wrap=True)
merge_3 = Merge(Data1=deplane_2.Origin, Data2=item_7)
pline_2 = PolyLine(Vertices=merge_3, Closed=False)
explode_5 = Explode(Curve=pline_2, Recursive=True)  # -> Segments, Vertices
pshift_5 = ShiftPaths(Data=shift_2, Offset=-1)
pshift_6 = ShiftPaths(Data=explode_5.Segments, Offset=-1)
divide_4 = DivideCurve(Curve=straight_2, Count=number_slider_2, Kinks=False)  # -> Points, Tangents, Parameters
divide_5 = DivideCurve(Curve=pshift_5, Count=number_slider_3, Kinks=False)  # -> Points, Tangents, Parameters
divide_6 = DivideCurve(Curve=pshift_6, Count=data_9, Kinks=False)  # -> Points, Tangents, Parameters
cull_i_5 = CullIndex(List=divide_4.Points, Indices="0", Wrap=True)
cull_i_6 = CullIndex(List=divide_5.Points, Indices="0", Wrap=True)
cull_i_7 = CullIndex(List=divide_6.Points, Indices="0", Wrap=True)
merge_4 = Merge(Data1=cull_i_5, Data2=cull_i_6)
pshift_7 = ShiftPaths(Data=merge_4, Offset="-2")
pshift_8 = ShiftPaths(Data=cull_i_7, Offset="-2")
c_script_4 = CSharpScript(
    outer=pshift_7,
    inner=pshift_8,
    nDivStraight=number_slider_2,
    nDivCorner=number_slider_3,
    filletRadius=Slider(0.5, range=0..1))  # -> out, A; inputs outer: list of Point3d, inner: list of Point3d, nDivStraight: Int32, nDivCorner: Int32, filletRadius: Double; same code as c_script_2
demesh_2 = DeconstructMesh(Mesh=c_script_4.A)  # -> Vertices, Faces, Colours, Normals
ln = Line(StartPoint=graft(demesh.Vertices), EndPoint=graft(demesh_2.Vertices))
pshift_9 = ShiftPaths(Data=ln, Offset=-1)
long_2 = LongestList(ListA=extr, ListB=pshift_9, PaddingMode=2)  # -> ListA, ListB
bcx = BrepCurve(Brep=long_2.ListA, Curve=long_2.ListB)  # -> Curves, Points
pshift_10 = ShiftPaths(Data=bcx.Points, Offset=-1)
conmesh = ConstructMesh(Vertices=pshift_10, Faces=demesh_2.Faces)
mesh = Mesh(conmesh)
mesh_2 = Mesh(c_script_4.A)
c_script_5 = CSharpScript(m=mesh)  # -> out, A; inputs m: Mesh
# ---------- c_script_5: C# ----------
A = m.GetNakedEdges();
# ---------- end c_script_5 ----------
c_script_6 = CSharpScript(m=mesh_2)  # -> out, A; inputs m: Mesh; same code as c_script_5
c_script_7 = CSharpScript(pl=c_script_6.A)  # -> out, A; inputs pl: Polyline
# ---------- c_script_7: C# ----------
A = pl.ToList();
# ---------- end c_script_7 ----------
c_script_8 = CSharpScript(pl=c_script_5.A)  # -> out, A; inputs pl: Polyline; same code as c_script_7
cull_i_8 = CullIndex(List=c_script_7.A, Indices=-1, Wrap=True)
cull_i_9 = CullIndex(List=c_script_8.A, Indices=-1, Wrap=True)
subtraction_9 = Subtraction(A=cull_i_8, B=cull_i_9)
unit = UnitVector(Vector=subtraction_9)
multiplication_3 = Multiplication(A=unit, B=Slider(0.5, range=0..1))
addition_5 = Addition(A=cull_i_9, B=multiplication_3)
c_script_9 = CSharpScript(a=cull_i_9, b=addition_5)  # -> out, A; inputs a: list of Point3d, b: list of Point3d
# ---------- c_script_9: C# ----------
Mesh mesh = new Mesh();

mesh.Vertices.AddVertices(a);
mesh.Vertices.AddVertices(b);

for (int i=0; i<a.Count; i++) {
    mesh.Faces.AddFace(
        i,
        (i+1)%a.Count,
        (i+1)%a.Count + a.Count,
        i + a.Count
    );
}

A = mesh;
# ---------- end c_script_9 ----------
c_script_10 = CSharpScript(a=addition_5, b=cull_i_8)  # -> out, A; inputs a: list of Point3d, b: list of Point3d; same code as c_script_9
pshift_11 = ShiftPaths(Data=c_script_9.A, Offset="-3")
pshift_12 = ShiftPaths(Data=c_script_10.A, Offset="-3")
mesh_3 = Mesh(mesh)
merge_5 = Merge(Data1=mesh_3, Data2=pshift_11, Data3=pshift_12)
mjoin = MeshJoin(Meshes=merge_5)
c_script_11 = CSharpScript(m=mjoin)  # -> out, A; inputs m: Mesh
# ---------- c_script_11: C# ----------
m.Vertices.CombineIdentical(true, true);

A = m;
# ---------- end c_script_11 ----------
flipm = FlipMesh(Mesh=c_script_11.A, VertexNormals=True, FaceNormals=True, FaceOrientation=True)
orient_2 = Orient(Geometry=flipm, Source=PlaneXY(0, 0, 0), Target=graft(key_base_plane))  # -> Geometry, Transform
